# Grasshopper definition esercitazione_1_autosav33e.gh (Grasshopper 1.0.8)

number_slider = Slider(76, range=0..100)
sqgrid = Square(Plane=PlaneXY(0, 0, 0), Size=Slider(9, range=0..200), ExtentX=number_slider, ExtentY=number_slider)  # -> Cells, Points
pt = Point()
area = Area(Geometry=sqgrid.Cells)  # -> Area, Centroid
cp = ClosestPoint(Point=area.Centroid, Cloud=pt)  # -> ClosestPoint, CPIndex, Distance
bnd = Bounds(Numbers=flatten(cp.Distance))
remap = RemapNumbers(Value=cp.Distance, Source=bnd, Target=Domain(0, 1))  # -> Mapped, Clipped
graph = GraphMapper(
    remap.Mapped,
    x0=0,
    x1=1,
    y0=0,
    y1=1,
    container_name="Bezier",
    cpx=[0, 0.3068834245, 0.9216365814, 1],
    cpy=[0, 0.9218841791, 0.1914125681, 1])
scale = Scale(Geometry=sqgrid.Cells, Center=area.Centroid, Factor=graph)  # -> Geometry, Transform
boundary = BoundarySurfaces(Edges=scale.Geometry)  # -> flatten(Surfaces)
gradient = Gradient(
    LowerLimit=0,
    UpperLimit=1,
    Parameter=flatten(graph),
    stops=[0: RGB(248, 222, 35), 0: RGB(183, 32, 197), 0: RGB(255, 130, 160), 0: RGB(237, 143, 224), 0: RGB(204, 193, 58), 0: RGB(46, 212, 22), 0.496: RGB(114, 202, 99), 0.59: RGB(220, 0, 40)])
preview = CustomPreview(Geometry=boundary, Material=gradient)
