# Grasshopper definition esercitazione_1_autosave.7gh.gh (Grasshopper 1.0.8)

number_slider = Slider(80, range=0..500)
square = Square(Plane=PlaneXY(0, 0, 0), Size=Slider(1, range=0..1), ExtentX=number_slider, ExtentY=number_slider)  # -> Cells, Points
point = Point()
area = Area(Geometry=square.Cells)  # -> Area, Centroid
closest_point = ClosestPoint(Point=area.Centroid, Cloud=point)  # -> ClosestPoint, CPIndex, Distance
bounds = Bounds(Numbers=flatten(closest_point.Distance))
remap_numbers = RemapNumbers(Value=closest_point.Distance, Source=bounds, Target=Domain(0, 1))  # -> Mapped, Clipped
graph_mapper = GraphMapper(
    remap_numbers.Mapped,
    x0=0,
    x1=1,
    y0=0,
    y1=1,
    container_name="Bezier",
    cpx=[0, 0.3068834245, 0.9216365814, 1],
    cpy=[0, 0.9218841791, 0.1914125681, 1])
scale = Scale(Geometry=square.Cells, Center=area.Centroid, Factor=graph_mapper)  # -> Geometry, Transform
boundary_surfaces = BoundarySurfaces(Edges=scale.Geometry)  # -> flatten(Surfaces)
gradient = Gradient(
    LowerLimit=0,
    UpperLimit=1,
    Parameter=flatten(graph_mapper),
    stops=[0: RGB(248, 222, 35), 0: RGB(46, 212, 22), 0.327: RGB(114, 202, 99), 0.564: RGB(204, 193, 58), 0.685: RGB(220, 0, 40), 0.866: RGB(255, 130, 160)])
custom_preview = CustomPreview(Geometry=boundary_surfaces, Material=gradient)
