# Grasshopper definition esercitazione_1_autosave.gh (Grasshopper 1.0.8)

number_slider = Slider(429, range=0..1000)
sqgrid = Square(Plane=PlaneXY(0, 0, 0), Size=Slider(1, range=0..1), ExtentX=number_slider, ExtentY=number_slider)  # -> Cells, Points
area = Area(Geometry=sqgrid.Cells)  # -> Area, Centroid
image_sampler = ImageSampler(
    area.Centroid,
    FilePath="/Users/matteopennacchio/Desktop/eschergrasshopper copia.jpg",
    Filter="Colour",
    Interpolate=False,
    Umax=1076,
    Umin=1,
    Vmax=1600,
    Vmin=1,
    Wrap=1)
circle = CircleCNR(Center=area.Centroid, Normal=image_sampler, Radius=image_sampler)
bnd = Bounds()
dom = ConstructDomain(DomainStart=Slider(0.74, range=0..1), DomainEnd=Slider(0, range=0..100))
remap = RemapNumbers(Value=image_sampler, Source=bnd, Target=dom)  # -> Mapped, Clipped
preview = CustomPreview(Geometry=circle, Material=ColourSwatch(SwatchColor=RGB(105, 10, 10)))
