# Grasshopper definition ll.gh (Grasshopper 1.0.8)
# plug-ins: PTComponentLibrary

swatch = ColourSwatch(SwatchColor=RGBA(215, 255, 255, 0))
ptpolar3d = Polar3DGrid(
    BasePlane=PlaneXY(0, 0, 0),
    RevolvePlane=Plane(origin=(10, 0, 0), x=(-0.7071067812, 0, 0.7071067812), y=(0, -1, 0)),
    RadialDistance=Slider(5, range=0..100),
    PolarAngle=Slider(100, range=0..100),
    RadialNumber=10,
    PolarNumber=10,
    FullCircle=False)
cir = Circle(Plane=ptpolar3d, Radius=Slider(75, range=0..100))
preview = CustomPreview(Geometry=cir, Material=ColourSwatch(SwatchColor=RGB(185, 249, 168)))
