# Grasshopper definition provaricetta.gh (Grasshopper 1.0.8)

number_slider = Slider(51, range=0..100)
sqgrid = Square(Plane=PlaneXY(0, 0, 0), Size=Slider(51, range=0..100), ExtentX=number_slider, ExtentY=number_slider)  # -> Cells, Points
number_slider_2 = Slider(39, range=0..100)
pt = Point(Point(174.3852103, 162.5195532, 0))
area = Area(Geometry=sqgrid.Cells)  # -> Area, Centroid
cp = PlaneClosestPoint(Point=area.Centroid, Plane=pt)  # -> Point, UVPoint, Distance
bnd = Bounds()
scale = Scale(Center=area.Centroid, Factor=0.5)  # -> Geometry, Transform
boundary = BoundarySurfaces(Edges=graft(scale.Geometry))
preview = CustomPreview(Geometry=boundary, Material=ColourSwatch(SwatchColor=RGB(173, 84, 255)))
dom = ConstructDomain(DomainStart=Slider(0.8, range=0..1), DomainEnd=Slider(0.9, range=0..1))
remap = RemapNumbers(Source=bnd, Target=dom)  # -> Mapped, Clipped
cir = Circle(Plane=cp.Point, Radius=remap.Mapped)
graph = GraphMapper(
    remap.Mapped,
    x0=10,
    x1=-1,
    y0=0,
    y1=-100,
    container_name="Bezier",
    cpx=[0, 0.9858657122, 0.4691126645, 1],
    cpy=[0, 0.005698025227, 0.5467118025, 1])
