# Grasshopper definition provaricetta_autosave.gh (Grasshopper 1.0.8)

hexgrid = Hexagonal(
    Plane=PlaneXY(0, 0, 0),
    Size=Slider(26, range=0..100),
    ExtentX=Slider(47, range=0..100),
    ExtentY=Slider(39, range=0..100))  # -> Cells, Points
pt = Point(hexgrid.Points)
dist = Distance(PointA=pt, PointB=hexgrid.Points)
bnd = Bounds(Numbers=flatten(dist))
dom = ConstructDomain(DomainStart=Slider(1, range=0..1), DomainEnd=Slider(0.6, range=0..1))
remap = RemapNumbers(Value=dist, Source=bnd, Target=dom)  # -> Mapped, Clipped
cir = Circle(Plane=hexgrid.Points, Radius=remap.Mapped)
graph = GraphMapper(
    remap.Mapped,
    x0=10,
    x1=35,
    y0=50,
    y1=35,
    container_name="Bezier",
    cpx=[0, 0.2852013707, 0.3923454881, 1],
    cpy=[0.2298769951, 0.8183354735, 0.2719032168, 1])
boundary = BoundarySurfaces(Edges=graft([cir, hexgrid.Cells]))
gradient = Gradient(
    LowerLimit=0,
    UpperLimit=1,
    Parameter=graph,
    stops=[0: RGB(220, 0, 40), 0: RGB(167, 66, 127), 0.153: RGB(71, 37, 37), 0.386: RGB(183, 205, 156), 0.475: RGB(176, 94, 204), 0.581: RGB(141, 34, 167), 0.679: RGB(120, 12, 28), 0.816: RGB(255, 130, 160)])
preview = CustomPreview(Geometry=boundary, Material=gradient)
