# Grasshopper definition rete_autosave.gh (Grasshopper 1.0.8)

number_slider = Slider(0, range=0..100)
cir = Circle(Plane=PlaneXY(0, 0, 0), Radius=Slider(20, range=0..100))
divide = DivideCurve(Curve=cir, Count=Slider(36, range=0..100), Kinks=False)  # -> Points, Tangents, Parameters
pt = ConstructPoint(XCoordinate=number_slider, YCoordinate=number_slider, ZCoordinate=number_slider)
vec2pt = Vector2Pt(PointA=pt, PointB=divide.Points, Unitize=False)  # -> Vector, Length
amp = Amplitude(Vector=vec2pt.Vector, Amplitude=Slider(2517, range=0..10000))
move = Move(Geometry=divide.Points, Motion=amp)  # -> Geometry, Transform
ln = Line(StartPoint=divide.Points, EndPoint=move.Geometry)
shift = ShiftList(List=move.Geometry, Shift=Slider(5, range=0..10), Wrap=True)
ln_2 = Line(StartPoint=divide.Points, EndPoint=shift)
