# Grasshopper definition sss.gh (Grasshopper 1.0.8)
# plug-ins: PTComponentLibrary

ptpolar3d = Polar3DGrid(
    BasePlane=PlaneXY(0, 0, 0),
    RevolvePlane=Plane(origin=(10, 0, 0), x=(-0.7071067812, 0, 0.7071067812), y=(0, -1, 0)),
    RadialDistance=Slider(9, range=0..100),
    PolarAngle=Slider(100, range=0..100),
    RadialNumber=10,
    PolarNumber=10,
    FullCircle=False)
polygon = Polygon(Plane=PlaneXY(0, 0, 0), Radius=ptpolar3d, Segments=Slider(57, range=0..100), FilletRadius=Slider(100, range=0..100))  # -> Polygon, Length
preview = CustomPreview(Geometry=ptpolar3d, Material=ColourSwatch(SwatchColor=RGBA(215, 255, 255, 0)))
cir = Circle(Plane=ptpolar3d, Radius=Slider(75, range=0..100))
preview_2 = CustomPreview(Geometry=cir, Material=ColourSwatch(SwatchColor=RGB(185, 249, 168)))
