# Grasshopper definition unnamed copia.gh (Grasshopper 1.0.8)

number_slider = Slider(20, range=-1.001..200)
square = Square(Plane=PlaneXY(0, 0, 0), Size=Slider(60, range=0..200), ExtentX=number_slider, ExtentY=number_slider)  # -> Cells, Points
# curva
curve = Curve(<curve referenced from the Rhino model>)
point = Point(square.Points)
construct_plane = ConstructPlane(Origin=Point(0, 0, 0), XAxis=Vector(1, 0, 0), YAxis=Vector(0, 1, 0))
panel = Panel(square.Cells)
panel_2 = Panel(square.Points)
deconstruct_plane = DeconstructPlane(Plane=construct_plane)  # -> Origin, XAxis, YAxis, ZAxis
pull_point = PullPoint(Point=point, Geometry=curve, ClosestOnly=True)  # -> ClosestPoint, Distance, Index
xy_plane = XYPlane(Origin=deconstruct_plane.YAxis)
xz_plane = XZPlane(Origin=deconstruct_plane.XAxis)
yz_plane = YZPlane(Origin=deconstruct_plane.ZAxis)
division = Division(A=pull_point.Distance, B=Slider(63, range=0..100))
minimum = Minimum(A=division, B=Slider(43, range=0..100))
bounds = Bounds(Numbers=minimum)
image_sampler = ImageSampler(
    square.Points,
    FilePath="/Users/matteopennacchio/Desktop/eschergrasshopper copia.jpg",
    Filter="Colour",
    Interpolate=False,
    Umax=1076,
    Umin=1,
    Vmax=1600,
    Vmin=1,
    Wrap=1)
deconstruct_domain = DeconstructDomain(Domain=bounds)  # -> Start, End
construct_domain = ConstructDomain(DomainStart=deconstruct_domain.End, DomainEnd=deconstruct_domain.Start)
remap_numbers = RemapNumbers(Value=minimum, Source=bounds, Target=construct_domain)  # -> Mapped, Clipped
stream_filter = StreamFilter(Gate=0, Stream0=minimum)
multiplication = Multiplication(A=stream_filter, B=Slider(19, range=0..100))
plane = Plane(image_sampler)
number_slider_2 = Slider(100, range=0..100)
extrude = Extrude(Base=plane, Direction=image_sampler)
domain_box = DomainBox(Base=point, X=number_slider_2, Y=number_slider_2, Z=multiplication)
panel_3 = Panel(multiplication)
cull_pattern = CullPattern(List=extrude, CullPattern=panel_3)
