# Grasshopper definition unnamed.gh (Grasshopper 1.0.8)
# plug-ins: PTComponentLibrary

number_slider = Slider(62, range=0..90)
swatch = ColourSwatch(SwatchColor=RGBA(215, 255, 255, 0))
number_slider_2 = Slider(100, range=0..100)
ptpolar3d = Polar3DGrid(
    BasePlane=PlaneXY(0, 0, 0),
    RevolvePlane=Plane(origin=(10, 0, 0), x=(-0.7071067812, 0, 0.7071067812), y=(0, -1, 0)),
    RadialDistance=Slider(16, range=0..100),
    PolarAngle=number_slider_2,
    RadialNumber=10,
    PolarNumber=10,
    FullCircle=False)
cir = Circle(Plane=ptpolar3d, Radius=Slider(75, range=0..100))
preview = CustomPreview(Geometry=cir, Material=ColourSwatch(SwatchColor=RGB(232, 255, 200)))
swatch_2 = ColourSwatch(SwatchColor=RGBA(215, 255, 255, 0))
ptpolar3d_2 = Polar3DGrid(
    BasePlane=PlaneXY(0, 0, 0),
    RevolvePlane=Plane(origin=(10, 0, 0), x=(-0.7071067812, 0, 0.7071067812), y=(0, -1, 0)),
    RadialDistance=Slider(40, range=0..100),
    PolarAngle=number_slider_2,
    RadialNumber=10,
    PolarNumber=10,
    FullCircle=False)
number_slider_3 = Slider(25, range=0..100)
cir_2 = Circle(Plane=ptpolar3d_2, Radius=cir)
preview_2 = CustomPreview(Geometry=cir_2, Material=ColourSwatch(SwatchColor=RGB(207, 255, 255)))
