# Grasshopper definition unnamed_autosave.gh (Grasshopper 1.0.8)

number_slider = Slider(100, range=-50.002..100)
number_slider_2 = Slider(53, range=50..100)
integer_division = IntegerDivision(A=number_slider)
box = CenterBox(Base=PlaneXY(0, 0, 0), X=number_slider, Y=number_slider, Z=number_slider)
debrep = DeconstructBrep(Brep=box)  # -> Faces, Edges, Vertices
sph = Sphere(Base=debrep.Vertices, Radius=number_slider_2)
area = Area(Geometry=debrep.Faces)  # -> Area, Centroid
sph_2 = Sphere(Base=area.Centroid, Radius=number_slider_2)
sdiff = SolidDifference(BrepsA=box, BrepsB=[sph_2, sph])
